# Grasshopper definition R0a.CreateFloorPlans-Reference_ver00.ghx (Grasshopper 1.0.7)
# plug-ins: SAM, Rhino.Inside for Autodesk Revit

# Reference - FloorPlan - Level00
panel = Panel("312")
query_element = QueryElement(Id=panel)
revit_duplicateplanview = RevitDuplicatePlanView(_viewPlan=query_element, _run=Toggle(True), SAM_ComponentVersion="1.0.0", SAM_SAMVersion="v20210310.1")
panel_2 = Panel(revit_duplicateplanview)
context_print = ContextPrint(Text=revit_duplicateplanview)
